# Grasshopper definition A bit of everything.gh (Grasshopper 1.0.7)
# plug-ins: Koala

bottom_corners = Point([Point(0, 0, 0), Point(0, 5, 0), Point(5, 5, 0), Point(6, 0, 0)])
top_corners = Point([Point(0, 0, 5), Point(0, 5, 5), Point(5, 6, 5), Point(5, 0, 5)])

corners_opening1 = Point([Point(1, 4, 0), Point(1, 3, 0), Point(2, 2, 0), Point(2, 3, 0)])
corners_opening2 = Point([Point(4.477725388, 4.361003126, 0), Point(3.251194741, 3.97633032, 0), Point(3.579012479, 3.051056056, 0), Point(4.530503806, 3, 0)])

# ---- group: Load panel positions
number_slider = Slider(0.3, range=0..1)
number_slider_2 = Slider(0.6, range=0..1)

# ----
# Geometry
line = Line(StartPoint=bottom_corners, EndPoint=top_corners)
polyline = PolyLine(Vertices=bottom_corners, Closed=True)
polyline_2 = PolyLine(Vertices=top_corners, Closed=True)
entwine = Entwine(Branch00=corners_opening1, Branch01=corners_opening2, FlattenInputs=True)
merge = Merge(Data1=polyline, Data2=polyline_2)
polyline_3 = PolyLine(Vertices=entwine, Closed=True)
column_lines = Line(line)
panel = Panel("""0.3
0.9""")
surface_top_bottom = Surface(merge)
evaluate_curve = EvaluateCurve(Curve=column_lines, Parameter=graft([number_slider, number_slider_2]))  # -> Point, Tangent, Angle
evaluate_curve_2 = EvaluateCurve(Curve=reparameterize(graft(surface_top_bottom)), Parameter=panel)  # -> Point, Tangent, Angle
shift_list = ShiftList(List=evaluate_curve.Point, Shift=1, Wrap=True)
polyline_4 = PolyLine(Vertices=shift_list, Closed=True)
polyline_5 = PolyLine(Vertices=evaluate_curve_2.Point, Closed=False)  # -> flatten(Polyline)
surface_for_load_panels = Surface(polyline_4)
line_internal_surface_edge = Line(polyline_5)
curve_openings = Curve(polyline_3)

shift_list_2 = ShiftList(List=top_corners, Shift=1, Wrap=True)
shift_list_3 = ShiftList(List=bottom_corners, Shift=1, Wrap=True)
number_slider_3 = Slider(0, range=0..3)
line_2 = Line(StartPoint=bottom_corners, EndPoint=shift_list_2)
line_3 = Line(StartPoint=shift_list_3, EndPoint=top_corners)
list_item = ListItem(List=line_2, Index=number_slider_3, Wrap=True)
list_item_2 = ListItem(List=line_3, Index=number_slider_3, Wrap=True)
line_bracings = Line([list_item, list_item_2])

node = Node(Point=[Point(1, 1, 0), Point(1, 2, 0)], NodePrefix="NSp")
list_item_3 = ListItem(List=node, Index=0, Wrap=True)  # -> flatten(Item)

cross_sections = Panel("""CS1
CS7
CS10
CS13
CS6""")
layer = Panel("Beams")

panel_2 = Panel("""constant|300
constant|450""")
layer_2 = Panel("Surfaces")
control_knob = ControlKnob(Decimals=0, Limit=False, Maximum=10, Minimum=0, Range=360, Value=0)

# ---- group: Join node names
text_join = TextJoin(Text=list_item_3, Join=";")
merge_2 = Merge(Data1=text_join)

# ----
control_knob_2 = ControlKnob(Decimals=0, Limit=False, Maximum=10, Minimum=0, Range=360, Value=0)
control_knob_3 = ControlKnob(Decimals=0, Limit=False, Maximum=10, Minimum=0, Range=360, Value=24)

_1d_member = _1DMember(
    Curve=flatten([column_lines, line_bracings]),
    Section=cross_sections,
    Layer=layer,
    NodePrefix="BN",
    MemberPrefix="B",
    Tolerance=0.001,
    RemDuplNodes=Toggle(True),
    StructuralType=0,
    FEMtype=0,
    MemberSystemLine=1,
    Ey=0,
    Ez=0)  # -> Nodes, _1DMember
list_item_4 = ListItem(List=_1d_member._1DMember, Index=0, Wrap=True)  # -> flatten(Item)

_2d_member = _2DMember(
    Surface=surface_top_bottom,
    Material="C20/25",
    Thickness=panel_2,
    Layer=layer_2,
    InternalNodes=merge_2,
    NodePrefix="SN",
    Tolerance=0.001,
    RemDuplNodes=Toggle(True),
    MemberSystemPlane=1,
    EccentricityZ=0,
    FEMNonlinearModel=0,
    MemberPrefix="S",
    SwapOrientation=False,
    LCSangle=control_knob)  # -> Nodes, _2DMember
list_item_5 = ListItem(List=_2d_member._2DMember, Index=0, Wrap=True)  # -> flatten(Item)
list_item_6 = ListItem(List=list_item_5, Index=0, Wrap=True)  # -> Item, Item1

beam = Panel("B2")
start_cs = Panel("CS7")
end_cs = Panel("CS8")

# ----
# FYI: InternalNodes are not connected to the member in SCIA. This is a bug.  Don't use internal nodes or connect them using the 'Connect Members/Nodes' command in SCIA. When calculating, connections can also be automatically added.
internal_node_on_1d_member = InternalNodeOn1DMember(Point=evaluate_curve.Point, MemberName=list_item_4, NodePrefix="IBN")

load_panel = LoadPanel(
    Surface=flatten(surface_for_load_panels),
    Layer="LoadPanels",
    PanelType=0,
    TransferDirection=2,
    TransferMethod=1,
    NodePrefix="LPN",
    Tolerance=0.001,
    RemDuplNodes=Toggle(True),
    MemberPrefix="LP",
    SwapOrientation=False,
    LCSangle=[control_knob_2, control_knob_3])  # -> Nodes, LoadPanel

# ----
# Members
internal_edge_on_2d_member = InternalEdgeOn2DMember(
    Line=line_internal_surface_edge,
    MemberName=list_item_5,
    EdgePrefix="ES",
    NodePrefix="NEN",
    Tolerance=0.001,
    RemDuplNodes=False)  # -> Nodes, InternalEdge
opening = Opening(ClosedCurve=curve_openings, Surface=list_item_6.Item, NodePrefix="NO", Tolerance=0.001, OpeningPrefix="O")  # -> Nodes, Opening
list_item_7 = ListItem(List=load_panel.Nodes, Index=0, Wrap=True)  # -> flatten(Item)

arbitraryprofile = ArbitraryProfile(Beams=beam, NamePrefix="AP", Section=start_cs, CoordDefinition=1, TypeOfCss=2, Css1=start_cs, Css2=end_cs, Alignment=0)

layer_definitions = Panel("""Beams;Layer for beams;no
Surfaces;Layer for surfaces;no
LoadPanels;Layer for surfaces;no""")
layers = Layers(LayerDefinition=layer_definitions)

sections = Panel("""CS1;FORM-1;HEB200;S 235
CS2;FORM-1;HEA200;S 235
CS3;FORM-4;L100X8;S 235
CS4;FORM-4;L80X8;S 235
CS5;FORM-4;L70X5;S 355
CS6;FORM-11;RD20;S 355
CS7;CONC;RECT1200x300;C30/37
CS8;CONC;RECT800x900;C30/37
CS10;CONC;TSEC1200x300x150x75;C30/37
CS11;CONC;ISEC1200x400x300x200x150x75;C30/37
CS12;CONC;LSEC1000x300x100x75;C30/37
CS13;CONC;LREV1000x300x100x75;C30/37
CS14;TIMB;RECT450x450;C14 (EN 338)
CS15;TIMB;CIRC400;C14 (EN 338)""")
cross_sections_2 = Cross_Sections(Sections=sections)

project_materials = ValueList({"Concrete", "Steel", "Timber", "Aluminium", "Masonry"}, selected=["Concrete", "Steel", "Timber"])
mesh_size = Slider(0.5, range=0.1..2)
scale = Slider(0, range=-3..3, expression="10^x")
# General
project_name = Panel("Stuff")
author = Panel("Me")
time = Time(638472225790000000)

projectdata = ProjectData(
    ProjectName=project_name,
    Description=project_name,
    Author=author,
    Date=time,
    StructureType=8,
    Materials=project_materials,
    MeshSize=mesh_size,
    Scale=scale,
    RemDuplNodes=Toggle(True),
    Tolerance=0.001)

# ---- group: All Nodes
merge_3 = Merge(
    Data1=flatten(node),
    Data2=flatten(_1d_member.Nodes),
    Data3=flatten(_2d_member.Nodes),
    Data4=flatten(opening.Nodes),
    Data5=flatten(load_panel.Nodes),
    Data6=flatten(internal_edge_on_2d_member.Nodes))

# ----
non_linear_function_name = Panel("NLF1")
panel_3 = Panel("""-1;-1
0;0
1;1""")

non_linear_function_name_2 = Panel("NLF2")
panel_4 = Panel("""-1;-1
0;0
1;1""")

# ----
# Tools
name_of_selection = Panel("MySelection")
selection_set = Panel("""B1
B2
S1
BN3
Sn2""")
selection = Selection(Name=name_of_selection, ObjectNames=selection_set, ObjectTypes=-1)

nonlinearfunction = NonlinearFunction(Name=non_linear_function_name, Type=0, PositiveEnd=0, NegativeEnd=0, GraphPoints=panel_3)

nonlinearfunction_2 = NonlinearFunction(Name=non_linear_function_name_2, Type=2, PositiveEnd=0, NegativeEnd=0, GrahpPoints=panel_4)

merge_4 = Merge(Data1=nonlinearfunction, Data2=nonlinearfunction_2)

points_at_supports = Point(bottom_corners)
flatten = FlattenTree(Tree=_1d_member.Nodes, Path="{0}")
cluster_node_at_coordinate = ClusterNodeAtCoordinate(list=flatten, P=points_at_supports)

abs_start_position = Slider(1.2, range=0..5)
abs_end_position = Slider(2.2, range=0..5)

posx = Slider(0.5, range=0..1)
repeat = Slider(2, range=1..3)
posx_2 = Slider(0.7, range=0..1)

# ---- group: INPUT
start_position = Slider(0.25, range=0..1)
end_position = Slider(0.6, range=0..1)
panel_5 = Panel("S1;1")

# ---- group: Names of bracing beams
list_item_8 = ListItem(List=list_item_4, Index=-1, Wrap=True)  # -> Item1, Item
concatenate = Concatenate(FragmentA=list_item_8.Item1, FragmentB=";", FragmentC=list_item_8.Item)

# ---- group: INPUT
name_of_supported_surface = Panel("S1")
name_of_subsoil = Panel("Subsoil1")

# ----
surface_edge_support = SurfaceEdgeSupport(
    Edge=panel_5,
    NamePrefix="SSE",
    Tx=2,
    Ty=2,
    Tz=7,
    Rx=2,
    Ry=2,
    Rz=2,
    StiffnessTx=10,
    StiffnessTy=20,
    StiffnessTz=30,
    StiffnessRx=40,
    StiffnessRy=50,
    StiffnessRz=60,
    FunctionTz=non_linear_function_name,
    CoordSystem=1,
    CoordDefinition=1,
    Position1=start_position,
    Position2=end_position,
    Origin=0)

# ----
# Supports
list_item_9 = ListItem(List=list_item_4, Index=0, Wrap=True)  # -> Item, Item1, Item2, Item3
panel_6 = Panel(surface_edge_support)

beam_point_support = BeamPointSupport(
    Beams=[list_item_9.Item, list_item_9.Item2],
    NamePrefix="SB",
    Tx=0,
    Ty=0,
    Tz=0,
    Rx=1,
    Ry=1,
    Rz=1,
    StiffnessTx=0,
    StiffnessTy=0,
    StiffnessTz=0,
    StiffnessRx=0,
    StiffnessRy=0,
    StiffnessRz=0,
    CoordSystem=0,
    CoordDefinition=1,
    PositionX=[posx, posx_2],
    Origin=0,
    Repeat=repeat,
    DeltaX=0.1)

beam_line_support = BeamLineSupport(
    Beams=[list_item_9.Item1, list_item_9.Item3],
    NamePrefix="SBL",
    Tx=1,
    Ty=1,
    Tz=0,
    Rx=0,
    Ry=0,
    Rz=0,
    StiffnessTx=0,
    StiffnessTy=0,
    StiffnessTz=0,
    StiffnessRx=0,
    StiffnessRy=0,
    StiffnessRz=0,
    CoordSystem=1,
    CoordDefinition=0,
    Position1=abs_start_position,
    Position2=abs_end_position,
    Origin=0)

# ----
# Warn!: Subsoil Non-Linear function specification doesn't seem to be correctly set in SCIA
surface_support = SurfaceSupport(Surfaces=name_of_supported_surface, NamePrefix="SSS", Subsoil=name_of_subsoil)
subsoil = Subsoil(
    SubsoilName=name_of_subsoil,
    Description="Defined subsoil for surface support",
    C1x=50,
    C1y=50,
    C1z=50,
    C2x=0,
    C2y=0,
    C1ztype=1,
    NonlinearFunction=non_linear_function_name_2)

node_support = NodeSupport(
    Nodes=cluster_node_at_coordinate,
    NamePrefix="Sn",
    Tx=1,
    Ty=1,
    Tz=1,
    Rx=1,
    Ry=1,
    Rz=1,
    StiffnessTx=0,
    StiffnessTy=0,
    StiffnessTz=0,
    StiffnessRx=0,
    StiffnessRy=0,
    StiffnessRz=0,
    CoordSystem="1",
    Angle="Rx20;Ry20;Rz20")

position_2_both = Panel("2")
non_linear_function_name_3 = Panel("NLF1")

# ----
# Links
crosslink = CrossLink(Type=1, CoupledMembers=concatenate)

hinge = HingeOnBeam(
    Beams=concatenate,
    NamePrefix="H",
    Position=position_2_both,
    Tx=1,
    Ty=1,
    Tz=3,
    Rx=0,
    Ry=0,
    Rz=0,
    StiffnessTx=0,
    StiffnessTy=0,
    StiffnessTz=10,
    StiffnessRx=0,
    StiffnessRy=0,
    StiffnessRz=0,
    FunctionTz=non_linear_function_name_3)

# ---- group: WiP
koalaloadcases_groups = KoalaLoadCases(LoadCases="LC2; Permanent; LG1", LoadGroups="LG2; Variable; Standard")  # -> LoadCases, LoadGroups
surfaceload = SurfaceLoad(LoadCase="LC2", SurfList=list_item_5, CoordSys=0, Direction=2, LoadValue=-4)

# ---- group: The magic
filename = Panel("C:/TEMP/KoalaSoup.xml")
boolean_toggle = BooleanToggle(True)

# Create XML
createxml = CreateXML(
    Run=boolean_toggle,
    FileName=filename,
    ProjectData=flatten(projectdata),
    Layer=flatten(layers),
    CrossSection=flatten(cross_sections_2),
    Selection=flatten(selection),
    Node=flatten(merge_3),
    _1DMember=flatten(_1d_member._1DMember),
    _2DMember=flatten(_2d_member._2DMember),
    LoadPanel=flatten(load_panel.LoadPanel),
    Opening=flatten(opening.Opening),
    ArbitraryProfile=flatten(arbitraryprofile),
    InternalEdge2D=flatten(internal_edge_on_2d_member.InternalEdge),
    NodeSupport=flatten(node_support),
    SurfaceEdgeSupport=flatten(surface_edge_support),
    BeamLineSupport=flatten(beam_line_support),
    BeamPointSupport=flatten(beam_point_support),
    SurfaceSupport=flatten(surface_support),
    Subsoil=flatten(subsoil),
    Hinge=flatten(hinge),
    CrossLink=flatten(crosslink),
    LoadCase=flatten(koalaloadcases_groups.LoadCases),
    LoadGroup=flatten(koalaloadcases_groups.LoadGroups),
    SurfaceLoad=flatten(surfaceload),
    NonLinearFunction=flatten(merge_4))

# ---- group: WiP
A = StartPoint(Point(3.587175359, 0.5224049389, 0))
B = EndPoint(Point(4.140812639, 0.4779668476, 0))
A_2 = StartPoint(Point(4.191153889, 1.183145484, 0))
B_2 = EndPoint(Point(3.686518926, 1.009454481, 0))
line_4 = Line(StartPoint=B, EndPoint=A_2)
line_5 = Line(StartPoint=A, EndPoint=B)
line_6 = Line(StartPoint=A_2, EndPoint=B_2)
line_7 = Line(StartPoint=B_2, EndPoint=A)
boundary_surfaces = BoundarySurfaces(Edges=[line_5, line_4, line_7, line_6])
line_8 = Line(StartPoint=Point(0.7872880502, 0.5798496115, 0), EndPoint=Point(3.107454536, 0.5574897246, 0))
linemomentonedge = LineMomentOnEdge(
    LoadCase="LC2",
    _2DMemberEdgeList="S1;1;edge",
    CoordSys=0,
    Direction=2,
    Distribution=0,
    LoadValue1=-100,
    LoadValue2=-100,
    CoordDefinition=0,
    Position1=0,
    Position2=1,
    Origin=0)
freepointmoment = FreePointMoment(
    LoadCase="LC2",
    Validity=0,
    Selection=0,
    CoordSys=4,
    Direction=0,
    LoadValue=-150,
    Points=Point(3.978138365, 2.025548552, 0),
    ValidityFrom=0,
    ValidityTo=0)
freelineload = FreeLineLoad(
    LoadCase="LC2",
    Validity=0,
    Selection=0,
    CoordSys=0,
    Direction=2,
    Distribution=0,
    LoadValue1=-1,
    LoadValue2=-1,
    Lines=line_8,
    ValidityFrom=0,
    ValidityTo=0)
freesurfaceload = FreeSurfaceLoad(
    LoadCase="LC2",
    Validity=0,
    Selection=0,
    CoordSys=0,
    Direction=2,
    LoadValue=-1,
    Boundaries=boundary_surfaces,
    ValidityFrom=0,
    ValidityTo=0)
freepointload = FreePointLoad(
    LoadCase="LC2",
    Validity=0,
    Selection=0,
    CoordSys=4,
    Direction=2,
    LoadValue=-1,
    Points=Point(4.025064737, 2.952786619, 0),
    ValidityFrom=0,
    ValidityTo=0)
koalaloadcases_groups_2 = KoalaLoadCases(LoadCases="LC2; Permanent; LG1", LoadGroups="LG2; Variable; Standard")  # -> LoadCases, LoadGroups
surfaceload_2 = SurfaceLoad(LoadCase="LC2", SurfList="S1", CoordSys=0, Direction=2, LoadValue=-4)
boolean_toggle_2 = BooleanToggle(True)
button = Button()
boolean = Boolean(True)
createxml_old = CreateXML(
    StructureType=8,
    UILanguage=0,
    Materials="Concrete",
    MeshSize=0.15,
    Sections=cross_sections_2,
    Loadcases=koalaloadcases_groups_2.LoadCases,
    Loadgroups=koalaloadcases_groups_2.LoadGroups,
    Surfaceloads=surfaceload_2,
    FreePointloads=freepointload,
    FreelLineloads=freelineload,
    FreeSurfaceloads=freesurfaceload,
    FileName="C:/TEMP/2Dmember.xml",
    Scale="1",
    RemDuplNodes=boolean_toggle_2,
    OnDemand=boolean_toggle_2,
    LineMomentsOnEdge=linemomentonedge,
    FreeMomentPoints=freepointmoment,
    Tolerance=0.001)  # disabled
createxml_2 = CreateXML(
    Run=boolean,
    FileName="C:/TEMP/2Dmember.xml",
    CrossSection=flatten(cross_sections_2),
    LoadCase=flatten(koalaloadcases_groups_2.LoadCases),
    LoadGroup=flatten(koalaloadcases_groups_2.LoadGroups),
    FreePointLoad=flatten(freepointload),
    FreePointMoment=flatten(freepointmoment),
    LineMomentEdge=flatten(linemomentonedge),
    FreeLineLoad=flatten(freelineload),
    SurfaceLoad=flatten(surfaceload_2),
    FreeSurfaceLoad=flatten(freesurfaceload))  # disabled
data_recorder = DataRecorder(createxml_old, DataLimit=-10, RecordData=True)
panel_7 = Panel(data_recorder)

boolean_toggle_3 = BooleanToggle(True)
cross_sections_3 = Panel("CS1")
layer_3 = Panel("Beams")
panel_8 = Panel("B")
panel_9 = Panel("BN")

filename_2 = Panel("C:/TEMP/KoalaSoupTests.xml")
boolean_toggle_4 = BooleanToggle(True)

list_item_10 = ListItem(List=column_lines, Index=0, Wrap=True)
sections_2 = Panel("CS1;FORM-1;HEB200;S 235")
cross_sections_4 = Cross_Sections(Sections=sections_2)
tree_branch = TreeBranch(Tree=simplify(node_support), Path="{0}", MaintainPaths=True)

_1d_member_2 = _1DMember(
    Curve=list_item_10,
    Section=cross_sections_3,
    Layer=layer_3,
    NodePrefix=panel_9,
    MemberPrefix=panel_8,
    Tolerance=0.001,
    RemDuplNodes=boolean_toggle_3,
    StructuralType=0,
    FEMtype=0,
    MemberSystemLine=1,
    Ey=0,
    Ez=0)  # -> Nodes, _1DMember
list_item_11 = ListItem(List=_1d_member_2._1DMember, Index=0, Wrap=True)  # -> flatten(Item)

createxml_3 = CreateXML(
    Run=boolean_toggle_4,
    FileName=filename_2,
    CrossSection=flatten(cross_sections_4),
    Node=flatten(_1d_member_2.Nodes),
    _1DMember=flatten(_1d_member_2._1DMember),
    NodeSupport=flatten(tree_branch))

# ==== cluster ClusterNodeAtCoordinate
list = ClusterInput()
P = ClusterInput()
partition_list = PartitionList(List=list, Size=4)
split_list = SplitList(List=partition_list, Index=1)  # -> ListA, ListB
trim_tree = TrimTree(Tree=split_list.ListA, Depth=2)
number = Number(split_list.ListB)
list_item = ListItem(List=number, Index=0, Wrap=True)  # -> Item, Item1, Item2
pdecon = Deconstruct(Point=P)  # -> XComponent, YComponent, ZComponent
expression = Expression(x=list_item.Item, y=list_item.Item1, z=list_item.Item2, Expression="{Round(x, 3),Round(y, 3),Round(z, 3)}")
expression_2 = Expression(x=pdecon.XComponent, y=pdecon.YComponent, z=pdecon.ZComponent, Expression="{Round(x, 3),Round(y, 3),Round(z, 3)}")
trim_tree_2 = TrimTree(Tree=expression, Depth=2)
mindex = MemberIndex(Set=trim_tree_2, Member=expression_2)  # -> Index, Count
trim_tree_3 = TrimTree(Tree=mindex.Index, Depth=1)
list_item_2 = ListItem(List=trim_tree, Index=trim_tree_3, Wrap=True)
i = ClusterOutput(list_item_2)
