# Grasshopper definition ArbitraryProfile.gh (Grasshopper 1.0.7)
# plug-ins: Koala

# ---- group: Geometry definition
line = LineSDL(Start=Point(5, 0, 0), Direction=Vector(0, 0, 1), Length=2)
line_2 = LineSDL(Start=Point(0, 0, 0), Direction=Vector(0, 0, 1), Length=2)
end = EndPoints(Curve=line_2)  # -> Start, End
end_2 = EndPoints(Curve=line)  # -> Start, End
ln = Line(StartPoint=end.End, EndPoint=end_2.End)

# ---- group: Koala arbitrary profiles for columns
panel = Panel("""2
0""")
panel_2 = Panel("""CS1
CS2""")
arbitraryprofile = ArbitraryProfile(Beams="B1;B2", NamePrefix="AP", Section="CS1", CoordDefinition=1, TypeOfCss=panel, Css1=panel_2, Css2="CS2", Alignment=0)
panel_3 = Panel(arbitraryprofile)

# ----
panel_4 = Panel("""0.3
0.4
0.3""")

# ---- group: Koala arbitrary profiles for beam
panel_5 = Panel("""2
0
2""")
panel_6 = Panel("""CS2
CS1
CS1""")
panel_7 = Panel("""CS1
CS1
CS2""")
arbitraryprofile_2 = ArbitraryProfile(
    Beams="B3",
    NamePrefix="AP",
    Section="CS2",
    CoordDefinition=1,
    Length=panel_4,
    TypeOfCss=panel_5,
    Css1=panel_6,
    Css2=panel_7,
    Alignment=3)
replace = ReplaceItems(List=arbitraryprofile_2, Item="AP3", Indices=1, Wrap=False)
panel_8 = Panel(replace)

# ---- group: Koala cross sections
panel_9 = Panel("""CS1;CONC;RECT1200x300;C30/37
CS2;CONC;RECT400x600;C30/37""")
cross_sections = Cross_Sections(Sections=panel_9)

# ---- group: Koala Beams
merge = Merge(Data1=line_2, Data2=line, Data3=ln)
merge_2 = Merge(Data1="CS1", Data2="CS1", Data3="CS2")
beams = Beams(
    Curves=merge,
    Sections=merge_2,
    Layers="Beams",
    NodePrefix="NB",
    Tolerance=0.001,
    RemDuplNodes=False,
    StructuralType=0,
    FEMType=0,
    MemberSystemLine=1,
    Ey=0,
    Ez=0,
    BeamNamePrefix="B")  # -> Nodes, Beams

# ---- group: Export to XML / EXPORT
button = Button()

# ---- group: Export to XML
path = FilePath("C:\temp\SCIA\koala_arbitrary_profile.xml")
panel_10 = Panel(path)
createxml = CreateXML(
    StructureType=8,
    UILanguage=0,
    Materials="Concrete",
    MeshSize=0.15,
    Sections=cross_sections,
    Nodes=beams.Nodes,
    Beams=beams.Beams,
    FileName=path,
    Scale="1",
    RemDuplNodes=False,
    OnDemand=button,
    Tolerance=0.001,
    ArbitraryProfiles=flatten([arbitraryprofile, replace]))
