# Grasshopper definition FreeSurfaceLoad.gh (Grasshopper 1.0.7)
# plug-ins: Koala

# ---- group: Input surfaces
# INFO
# GENERAL INFO
# ¯¯¯¯¯¯¯¯¯¯¯¯¯¯¯¯¯¯¯¯¯¯¯¯¯¯¯¯¯¯¯¯¯¯¯¯
# Author: KRO
# Company: BESIX Engineering
# Email: kelvin.roovers@besix.com
# 
# Grasshopper version: 1.0.0007
# Rhino version: 7.11
# 
# 
# VERSION HISTORY
# ¯¯¯¯¯¯¯¯¯¯¯¯¯¯¯¯¯¯¯¯¯¯¯¯¯¯¯¯¯¯¯¯¯¯¯¯
# v0.01 (2022-12-07)
# Sample created to demonstrate new FreeSurfaceLoad node
# INSTRUCTIONS
# ¯¯¯¯¯¯¯¯¯¯¯¯¯¯¯¯¯¯¯¯¯¯¯¯¯¯¯¯¯¯¯¯¯¯¯¯
# Script to demonstrate the use of Koala FreeSurfaceLoad and EdgeSupport nodes
srf = Surface([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])

# ---- group: INPUT points for free surface loads
point = Point([Point(1, 6, 0), Point(3, 8, 0), Point(5, 6, 0), Point(5, 2, 0), Point(8, 2, 0)])

# ---- group: Koala edge supports
edge_index_starts_at_1 = Panel("""S1;SURFACE;5
S3;SURFACE;1""")
edgesupport = EdgeSupport(
    ListOfSurfaces_EdgesType=edge_index_starts_at_1,
    Rx=1,
    Ry=1,
    Rz=1,
    Tx=1,
    Ty=1,
    Tz=1,
    StiffnessRx=0,
    StiffnessRy=0,
    StiffnessRz=0,
    StiffnessTx=0,
    StiffnessTy=0,
    StiffnessTz=0,
    CoordDefinition=0,
    Position1=0,
    Position2=1,
    Origin=0)

# ---- group: Koala FreeSurfaceLoad
bbox = BoundingBox(Content=srf, Plane=PlaneXY(0, 0, 0), UnionBox=True)  # -> Box, Box_2
edges = BrepEdges(Brep=bbox.Box_2)  # -> Naked, Interior, NonManifold
join = JoinCurves(Curves=edges.Naked, Preserve=False)
freesurfaceload = FreeSurfaceLoad(
    LoadCase="LC2",
    Validity=0,
    Selection=0,
    CoordSys=0,
    Direction=2,
    Distribution=0,
    LoadValue1=-1,
    LoadValue2=-1,
    Boundary=join,
    ValidityFrom=0,
    ValidityTo=0,
    Members2D="S1;SURFACE;1 | S3")

# ----
polyline = PolyLine(Vertices=point, Closed=False)
explode = Explode(Curve=polyline, Recursive=True)  # -> Segments, Vertices
freelineload = FreeLineLoad(
    LoadCase="LC2",
    Validity=0,
    Selection=1,
    CoordSys=0,
    Direction=2,
    Distribution=0,
    LoadValue1=-1,
    LoadValue2=-1,
    Lines=polyline,
    ValidityFrom=0,
    ValidityTo=0)

# ---- group: Koala Members2D
panel = Panel("constant|150")
_2d_member = _2DMember(
    Surfaces=srf,
    Material="C20/25",
    Thickness="150",
    Layer="Surfaces",
    NodePrefix="N",
    Tolerance=0.001,
    RemDuplNodes=Toggle(True),
    MemberSystemPlane=1,
    EccentricityZ=0,
    FEMNonlinearModel=0,
    MemberPrefix="S",
    SwapOrientation=False,
    LCSangle=0)  # -> Nodes, _2DMembers

# ---- group: Distinguish inner and outer boundaries
edges_2 = BrepEdges(Brep=srf)  # -> Naked, Interior, NonManifold
join_2 = JoinCurves(Curves=edges_2.Naked, Preserve=False)
split = SplitList(List=join_2, Index=1)  # -> flatten(ListA), ListB
explode_2 = Explode(Curve=split.ListA, Recursive=True)  # -> Segments, Vertices

# ---- group: Distinguish inner and outer boundaries / algorithm applied by Koala to get surface boundary edges
vb = VBScript(s=srf)  # -> out, edges; inputs s: Brep
# ---------- vb: VB ----------
    Dim nakededges() As Rhino.Geometry.Curve
    Dim joinedcurves() As Rhino.Geometry.Curve
    Dim segments() As Rhino.Geometry.Curve

    nakededges = s.DuplicateNakedEdgeCurves(True, False) 'this contains an unsorted list of edges
    'join
    joinedcurves = Rhino.Geometry.Curve.JoinCurves(nakededges)
    'explode the first curve back to segments - this should now be properly sorted
    If joinedcurves(0).IsCircle() Then
      ReDim Preserve segments(0)
      segments.SetValue(joinedcurves(0), 0)
    Else
      segments = joinedcurves(0).DuplicateSegments
    End If

    edges = segments
# ---------- end vb ----------

# ----
panel_2 = Panel(freesurfaceload)
panel_3 = Panel(freelineload)

# ---- group: Koala surface openings
item = ListItem(List=_2d_member._2DMembers, Index=0, Wrap=True)
lng = ListLength(List=split.ListB)
repeat = RepeatData(Data=item, Length=lng)  # -> flatten(Data)
openings = Openings(ClosedCurves=flatten(split.ListB), Surface=repeat, NodePrefix="NO", Tolerance=0.001, OpeningNamePrefix="O")  # -> Nodes, Openings

# ---- group: Koala LC and LG definitions
koalaloadcases_groups = KoalaLoadCases(LoadCases="LC2; Permanent; LG1", LoadGroups="LG2; Variable; Standard")  # -> LoadCases, LoadGroups

# ---- group: Previes SCIA edge order
# Reconstruct edges and determine order (needed for EdgeSupport definitions)
panel_4 = Panel("5")
item_2 = ListItem(List=_2d_member.Nodes, Index=0, Wrap=True)  # -> flatten(Item), flatten(Item1), flatten(Item2), flatten(Item3)
item_3 = ListItem(List=_2d_member._2DMembers, Index=panel_4, Wrap=True)  # -> flatten(Item)
pt = ConstructPoint(XCoordinate=item_2.Item1, YCoordinate=item_2.Item2, ZCoordinate=item_2.Item3)
split_2 = TextSplit(Text=item_3, Separators="|")
split_3 = TextSplit(Text=split_2, Separators=";")
item_4 = ListItem(List=split_3, Index=-1, Wrap=True)
trim = TrimTree(Tree=item_4, Depth=1)
trim_2 = TextTrim(Text=trim, Start=True, End=True)
mindex = MemberIndex(Set=item_2.Item, Member=trim_2)  # -> Index, Count
item_5 = ListItem(List=pt, Index=mindex.Index, Wrap=True)
trim_3 = TrimTree(Tree=item_5, Depth=1)
shift = ShiftList(List=trim_3, Shift=1, Wrap=True)
ln = Line(StartPoint=trim_3, EndPoint=shift)
curvepoint = PointOnCurve(ln, parameter=0.716)
points = PointList(Points=curvepoint, Size=0.5)

# ---- group: Preview Grasshopper edge order
curvepoint_2 = PointOnCurve(explode_2.Segments, parameter=0.433)
points_2 = PointList(Points=curvepoint_2, Size=0.5)

# ---- group: Export to XML / EXPORT
toggle = BooleanToggle(True)
button = Button()

# ---- group: Export to XML
path = FilePath("C:\temp\SCIA\koala_freesurfaceload.xml")
panel_5 = Panel(path)
createxml = CreateXML(
    StructureType=8,
    UILanguage=0,
    Materials="Concrete",
    MeshSize=0.15,
    Nodes=flatten([_2d_member.Nodes, openings.Nodes]),
    Surfaces=flatten(_2d_member._2DMembers),
    Openings=openings.Openings,
    Edgesupports=edgesupport,
    Loadcases=koalaloadcases_groups.LoadCases,
    Loadgroups=koalaloadcases_groups.LoadGroups,
    FreelLineloads=freelineload,
    FreeSurfaceloads=flatten(freesurfaceload),
    FileName=path,
    Scale="1",
    RemDuplNodes=False,
    OnDemand=toggle,
    Tolerance=0.001)
