# Grasshopper definition Integration Strip and Section on Beam simple example.gh (Grasshopper 1.0.7)
# plug-ins: Koala

# ---- group: Slab
plane_surface = PlaneSurface(Plane=PlaneXY(0, 0, 0), XSize=Domain(-2, 2), YSize=Domain(-2, 2))
_2d_member = _2DMember(
    Surface=plane_surface,
    Material="C20/25",
    Thickness="constant|200",
    Layer="Surfaces",
    NodePrefix="N2D",
    Tolerance=0.001,
    RemDuplNodes=False,
    MemberSystemPlane=1,
    EccentricityZ=0,
    FEMNonlinearModel=0,
    MemberPrefix="S",
    SwapOrientation=False,
    LCSangle=0)  # -> Nodes, _2DMember

# ---- group: Columns in the coreners
unit_z = UnitZ(Factor=-1)
deconstruct_brep = DeconstructBrep(Brep=plane_surface)  # -> Faces, Edges, Vertices
line_sdl = LineSDL(Start=deconstruct_brep.Vertices, Direction=unit_z, Length=Slider(4.1, range=1..10))
_1d_member = _1DMember(
    Curve=line_sdl,
    Section="CS1",
    Layer="Beams",
    NodePrefix="NB",
    Tolerance=0.001,
    RemDuplNodes=False,
    StructuralType=0,
    FEMtype=0,
    MemberSystemLine=1,
    Ey=0,
    Ez=0,
    MemberPrefix="B")  # -> Nodes, _1DMember

# ---- group: Rectangular concrete cross-section (400 x 400)
pile_cross_section = Panel("CS1;CONC;RECT400x400;C20/25")
crosssections = CrossSections(Sections=pile_cross_section)

# ----
slab_edges = Curve(deconstruct_brep.Edges)

# ---- group: Select line for intgration strips
list_item = ListItem(List=slab_edges, Index=0, Wrap=True)
unit_y = UnitY(Factor=3)
move = Move(Geometry=list_item, Motion=unit_y)  # -> Geometry, Transform

# ----
list_item_2 = ListItem(List=_2d_member._2DMember, Index=0, Wrap=True)

# ---- group: Select 1D Members to assign sections
list_item_3 = ListItem(List=_1d_member._1DMember, Index=0, Wrap=True)  # -> flatten(Item)
dispatch = Dispatch(List=list_item_3, DispatchPattern=[True, False])  # -> ListA, ListB

# ---- group: Nodal support at the bottom of the columns
list_item_4 = ListItem(List=_1d_member.Nodes, Index=0, Wrap=True)  # -> flatten(Item)
shift_list = ShiftList(List=list_item_4, Shift=1, Wrap=True)
cull_nth = CullNth(List=shift_list, CullFrequency=2)
nodesupport = NodeSupport(
    ListOfNodes=cull_nth,
    Rx=1,
    Ry=1,
    Rz=1,
    Tx=1,
    Ty=1,
    Tz=1,
    StiffnessRx=0,
    StiffnessRy=0,
    StiffnessRz=0,
    StiffnessTx=0,
    StiffnessTy=0,
    StiffnessTz=0,
    Angle="Rx0,Ry0,Rz0")

# ---- group: Integration strip - nonsymmetrical
intergation_strip = IntergationStrip(
    _2DMemberName=list_item_2,
    Line=list_item,
    CreateMeshNode=False,
    EffectiveWidthGeometry=1,
    EffectiveWidthDefinition=1,
    Width=1,
    Thickness=1.35,
    IntegrationStripPrefix="NonSymmIntStrip",
    Left=Slider(0.7, range=0..1),
    Right=Slider(0, range=0..1))

# ---- group: Multiple section on column
# Remember to change names (prefix)
# in case you are using the node more than once!!
section_on_beam = SectionOnBeam(
    _1DMemberName=dispatch.ListB,
    SectionPrefix="SB_abs",
    CoordDefinition=0,
    Position=0.5,
    Origin=1,
    RepeatN=Slider(3, range=0..10),
    DeltaX="1.1")

# ---- group: Simple integration strip
# Remember to change names (prefix)
# in case you are using the node more than once!!
intergation_strip_2 = IntergationStrip(
    _2DMemberName=list_item_2,
    Line=move.Geometry,
    CreateMeshNode=True,
    EffectiveWidthGeometry=0,
    EffectiveWidthDefinition=0,
    Width=1,
    Thickness=1,
    IntegrationStripPrefix="CM")

# ---- group: Single section in the middle of the column
section_on_beam_2 = SectionOnBeam(_1DMemberName=dispatch.ListA, SectionPrefix="SB", CoordDefinition=1, Position=0.5, Origin=0, RepeatN=1, DeltaX=0.1)

# ---- group: Genertae xml
createxml = CreateXML(
    Run=Button(),
    FileName="C:\Temp\integration_strip_and_sections_on_beam.xml",
    CrossSection=flatten(crosssections),
    Node=flatten([_1d_member.Nodes, _2d_member.Nodes]),
    _2DMember=flatten(_2d_member._2DMember),
    _1DMember=flatten(_1d_member._1DMember),
    NodeSupport=flatten(nodesupport),
    IntegrationStrip=flatten([intergation_strip_2, intergation_strip]),
    SectionOnBeam=flatten([section_on_beam_2, section_on_beam]))
data_recorder = DataRecorder(createxml, DataLimit=-10, RecordData=True)
panel = Panel(data_recorder)
