# Grasshopper definition KoalaConvert.gh (Grasshopper 1.0.8)
# plug-ins: Koala

bottom_corners = Point([Point(0, 0, 0), Point(0, 5, 0), Point(5, 5, 0), Point(6, 0, 0)])
top_corners = Point([Point(0, 0, 5), Point(0, 5, 5), Point(5, 6, 5), Point(5, 0, 5)])

corners_opening1 = Point([Point(1, 4, 0), Point(1, 3, 0), Point(2, 2, 0), Point(2, 3, 0)])
corners_opening2 = Point([Point(4.477725388, 4.361003126, 0), Point(3.251194741, 3.97633032, 0), Point(3.579012479, 3.051056056, 0), Point(4.530503806, 3, 0)])

# ---- group: Load panel positions
number_slider = Slider(0.6, range=0..1)
number_slider_2 = Slider(0.3, range=0..1)

# ----
# Geometry
line = Line(StartPoint=bottom_corners, EndPoint=top_corners)
polyline = PolyLine(Vertices=bottom_corners, Closed=True)
polyline_2 = PolyLine(Vertices=top_corners, Closed=True)
entwine = Entwine(Branch00=corners_opening1, Branch01=corners_opening2, FlattenInputs=True)
merge = Merge(Data1=polyline, Data2=polyline_2)
polyline_3 = PolyLine(Vertices=entwine, Closed=True)
column_lines = Line(line)
panel = Panel("""0.3
0.9""")
surface_top_bottom = Surface(merge)
evaluate_curve = EvaluateCurve(Curve=column_lines, Parameter=graft([number_slider_2, number_slider]))  # -> Point, Tangent, Angle
evaluate_curve_2 = EvaluateCurve(Curve=reparameterize(graft(surface_top_bottom)), Parameter=panel)  # -> Point, Tangent, Angle
shift_list = ShiftList(List=evaluate_curve.Point, Shift=1, Wrap=True)
polyline_4 = PolyLine(Vertices=shift_list, Closed=True)
polyline_5 = PolyLine(Vertices=evaluate_curve_2.Point, Closed=False)  # -> flatten(Polyline)
surface_for_load_panels = Surface(polyline_4)
line_internal_surface_edge = Line(polyline_5)
curve_openings = Curve(polyline_3)

shift_list_2 = ShiftList(List=top_corners, Shift=1, Wrap=True)
shift_list_3 = ShiftList(List=bottom_corners, Shift=1, Wrap=True)
number_slider_3 = Slider(0, range=0..3)
line_2 = Line(StartPoint=bottom_corners, EndPoint=shift_list_2)
line_3 = Line(StartPoint=shift_list_3, EndPoint=top_corners)
list_item = ListItem(List=line_2, Index=number_slider_3, Wrap=True)
list_item_2 = ListItem(List=line_3, Index=number_slider_3, Wrap=True)
line_bracings = Line([list_item, list_item_2])

node = Node(Point=[Point(1, 1, 0), Point(1, 2, 0)], NodePrefix="NSp")
list_item_3 = ListItem(List=node, Index=0, Wrap=True)  # -> flatten(Item)

cross_sections = Panel("""CS1
CS7
CS10
CS13
CS6""")
layer = Panel("Beams")

panel_2 = Panel("""constant|300
constant|450""")
layer_2 = Panel("Surfaces")
control_knob = ControlKnob(Decimals=0, Limit=False, Maximum=10, Minimum=0, Range=360, Value=0)

# ---- group: Join node names
text_join = TextJoin(Text=list_item_3, Join=";")
merge_2 = Merge(Data1=text_join)

# ----
control_knob_2 = ControlKnob(Decimals=0, Limit=False, Maximum=10, Minimum=0, Range=360, Value=0)
control_knob_3 = ControlKnob(Decimals=0, Limit=False, Maximum=10, Minimum=0, Range=360, Value=24)

_1d_member = _1DMember(
    Curve=flatten([column_lines, line_bracings]),
    Section=cross_sections,
    Layer=layer,
    NodePrefix="BN",
    MemberPrefix="B",
    Tolerance=0.001,
    RemDuplNodes=Toggle(True),
    StructuralType=0,
    FEMtype=0,
    MemberSystemLine=1,
    Ey=0,
    Ez=0)  # -> Nodes, _1DMember
list_item_4 = ListItem(List=_1d_member._1DMember, Index=0, Wrap=True)  # -> flatten(Item)

_2d_member = _2DMember(
    Surface=surface_top_bottom,
    Material="C20/25",
    Thickness=panel_2,
    Layer=layer_2,
    InternalNodes=merge_2,
    NodePrefix="SN",
    Tolerance=0.001,
    RemDuplNodes=Toggle(True),
    MemberSystemPlane=1,
    EccentricityZ=0,
    FEMNonlinearModel=0,
    MemberPrefix="S",
    SwapOrientation=False,
    LCSangle=control_knob)  # -> Nodes, _2DMember
list_item_5 = ListItem(List=_2d_member._2DMember, Index=0, Wrap=True)  # -> flatten(Item)
list_item_6 = ListItem(List=list_item_5, Index=0, Wrap=True)  # -> Item, Item1

beam = Panel("B2")
start_cs = Panel("CS7")
end_cs = Panel("CS8")

line_4 = Line(Line((5, 1, 0), (5, 3, 0)))
section_on_2d = SectionOn2D(SectionPrefix="SE", Layer="Surfaces", Draw=3, DirectionOfCut=Vector(2, 0, 1), Line=line_4)

load_panel = LoadPanel(
    Surface=flatten(surface_for_load_panels),
    Layer="LoadPanels",
    PanelType=0,
    TransferDirection=2,
    TransferMethod=1,
    NodePrefix="LPN",
    Tolerance=0.001,
    RemDuplNodes=Toggle(True),
    MemberPrefix="LP",
    SwapOrientation=False,
    LCSangle=[control_knob_2, control_knob_3])  # -> Nodes, LoadPanel

# ----
# Members
internal_edge_on_2d_member = InternalEdgeOn2DMember(
    Line=line_internal_surface_edge,
    MemberName=list_item_5,
    EdgePrefix="ES",
    NodePrefix="NEN",
    Tolerance=0.001,
    RemDuplNodes=False)  # -> Nodes, InternalEdge
opening = Opening(ClosedCurve=curve_openings, Surface=list_item_6.Item, NodePrefix="NO", Tolerance=0.001, OpeningPrefix="O")  # -> Nodes, Opening
list_item_7 = ListItem(List=load_panel.Nodes, Index=0, Wrap=True)  # -> flatten(Item)

arbitraryprofile = ArbitraryProfile(Beams=beam, NamePrefix="AP", Section=start_cs, CoordDefinition=1, TypeOfCss=2, Css1=start_cs, Css2=end_cs, Alignment=0)

# ---- group: Wrap inside convertible object
expected_node_keys = Panel("""Name
X
Y
Z""")
expected_member1d_keys = Panel("""Name
Section
Layer
Shape
LcsType
LcsX
LcsY
LcsZ
StructuralType
FEMType
Alignment
ey
ez
BucklingGroupIndex""")
expected_member1d_keys_2 = Panel("""Name
StructuralType
Material
Thickness
Layer
Shape
InternalNodes
Alignment
ez
FEMType
SwapOrientation
LcsAngle""")
c_to_dictionary = CSharpScript(type="Node", values=[node, _1d_member.Nodes], keys=expected_node_keys)  # -> a; inputs type: String, values: list of String, keys: list of String
# ---------- c_to_dictionary: C# ----------
// Grasshopper Script Instance
#region Usings
using System;
using System.Linq;
using System.Collections;
using System.Collections.Generic;
using System.Drawing;

using Rhino;
using Rhino.Geometry;

using Grasshopper;
using Grasshopper.Kernel;
using Grasshopper.Kernel.Data;
using Grasshopper.Kernel.Types;
#endregion
public class Script_Instance : GH_ScriptInstance
{
    #region Notes
    /* 
      Members:
        RhinoDoc RhinoDocument
        GH_Document GrasshopperDocument
        IGH_Component Component
        int Iteration

      Methods (Virtual & overridable):
        Print(string text)
        Print(string format, params object[] args)
        Reflect(object obj)
        Reflect(object obj, string method_name)
    */
    #endregion

    private void RunScript(
		string type,
		List<string> values,
		List<string> keys,
		ref object a)
    {
        // Write your logic here
        var result = new Dictionary<string, string>
        {
            {"ObjectType", type}
        };

        for (int i = 0; i < Math.Min(values.Count, keys.Count); i++)
        {
            result[keys[i]] = values[i];
        }

        // Wrap in list for Grasshopper to return value as a single object
        a = new List<Dictionary<string, string>> { result };
    }
}
# ---------- end c_to_dictionary ----------
c_to_dictionary_2 = CSharpScript(type="Member1D", values=_1d_member._1DMember, keys=expected_member1d_keys)  # -> a; inputs type: String, values: list of String, keys: list of String; same code as c_to_dictionary
c_to_dictionary_3 = CSharpScript(type="Member2D", values=_2d_member._2DMember, keys=expected_member1d_keys_2)  # -> a; inputs type: String, values: list of String, keys: list of String; same code as c_to_dictionary
c_to_convertible = CSharpScript(data=flatten([c_to_dictionary, c_to_dictionary_2, c_to_dictionary_3]))  # -> a; inputs data: list
# ---------- c_to_convertible: C# ----------
// Grasshopper Script Instance
#region Usings
using System;
using System.Linq;
using System.Collections;
using System.Collections.Generic;
using System.Drawing;

using Rhino;
using Rhino.Geometry;

using Grasshopper;
using Grasshopper.Kernel;
using Grasshopper.Kernel.Data;
using Grasshopper.Kernel.Types;
#endregion

public class KoalaConvertible
{
    readonly List<Dictionary<string, string>> data = new List<Dictionary<string, string>>();

    public KoalaConvertible(List<object> objects) 
    {
        foreach (var obj in objects)
        {
            if (obj is Dictionary<string, string> stringDict)
            {
                data.Add(stringDict);
            }
            else if (obj is Dictionary<object, object> objDict)
            {
                var converted = objDict.ToDictionary(kvp => kvp.Key.ToString(), kvp => kvp.Value?.ToString());
                data.Add(converted);
            }
        }
    }

    /// Required public method for KoalaConvert component
    public List<Dictionary<string, string>> ToKoala() => data;

    public override string ToString()
    {
        return string.Format("KoalaObjectCollection(Count = {0})", data.Count);
    }
}

public class Script_Instance : GH_ScriptInstance
{
    #region Notes
    /* 
      Members:
        RhinoDoc RhinoDocument
        GH_Document GrasshopperDocument
        IGH_Component Component
        int Iteration

      Methods (Virtual & overridable):
        Print(string text)
        Print(string format, params object[] args)
        Reflect(object obj)
        Reflect(object obj, string method_name)
    */
    #endregion

    private void RunScript(List<object> data, ref object a)
    {
        a = new KoalaConvertible(data);
    }
}
# ---------- end c_to_convertible ----------
panel_3 = Panel(c_to_convertible)

# ---- group: All Nodes
merge_3 = Merge(
    Data1=flatten(node),
    Data2=flatten(_1d_member.Nodes),
    Data3=flatten(_2d_member.Nodes),
    Data4=flatten(opening.Nodes),
    Data5=flatten(load_panel.Nodes),
    Data6=flatten(internal_edge_on_2d_member.Nodes))

# ----
koalaconvert = KoalaConvert(Data=c_to_convertible)  # -> Node, _1DMember, _2DMember
panel_4 = Panel(koalaconvert._2DMember)
panel_5 = Panel(_2d_member._2DMember)
panel_6 = Panel(node)

non_linear_function_name = Panel("NLF1")
panel_7 = Panel("""-1;-1
0;0
1;1""")

panel_8 = Panel("""-1;-1
0;0
1;1""")
non_linear_function_name_2 = Panel("NLF2")

nonlinearfunction = NonlinearFunction(Name=non_linear_function_name, Type=0, PositiveEnd="Free", NegativeEnd="Flexible", GraphPoints=panel_7)

nonlinearfunction_2 = NonlinearFunction(Name=non_linear_function_name_2, Type=2, PositiveEnd=0, NegativeEnd=0, GrahpPoints=panel_8)

merge_4 = Merge(Data1=nonlinearfunction, Data2=nonlinearfunction_2)

abs_start_position = Slider(1.2, range=0..5)
abs_end_position = Slider(2.2, range=0..5)

posx = Slider(0.5, range=0..1)
posx_2 = Slider(0.7, range=0..1)
repeat = Slider(2, range=1..3)

# ---- group: INPUT
start_position = Slider(0.25, range=0..1)
end_position = Slider(0.6, range=0..1)
panel_9 = Panel("S1;1")

# ----
points_at_supports = Point(bottom_corners)
nodeatpoint = NodeAtPoint(nodedata=flatten(_1d_member.Nodes), points=points_at_supports)

layer_definitions = Panel("""Beams;Layer for beams;no
Surfaces;Layer for surfaces;no
LoadPanels;Layer for surfaces;no""")
layers = Layers(LayerDefinition=layer_definitions)

sections = Panel("""CS1;FORM-1;HEB200;S 235
CS2;FORM-1;HEA200;S 235
CS3;FORM-4;L100X8;S 235
CS4;FORM-4;L80X8;S 235
CS5;FORM-4;L70X5;S 355
CS6;FORM-11;RD20;S 355
CS7;CONC;RECT1200x300;C30/37
CS8;CONC;RECT800x900;C30/37
CS10;CONC;TSEC1200x300x150x75;C30/37
CS11;CONC;ISEC1200x400x300x200x150x75;C30/37
CS12;CONC;LSEC1000x300x100x75;C30/37
CS13;CONC;LREV1000x300x100x75;C30/37
CS14;TIMB;RECT450x450;C14 (EN 338)
CS15;TIMB;CIRC400;C14 (EN 338)""")
crosssections = Cross_Sections(Sections=sections)

project_materials = ValueList({"Concrete", "Steel", "Timber", "Aluminium", "Masonry"}, selected=["Concrete", "Steel", "Timber"])
mesh_size = Slider(0.5, range=0.1..2)
scale = Slider(0, range=-3..3, expression="10^x")
# General
project_name = Panel("Stuff")
author = Panel("Me")
time = Time(638472225790000000)

# ---- group: Names of bracing beams
list_item_8 = ListItem(List=list_item_4, Index=-1, Wrap=True)  # -> Item1, Item
concatenate = Concatenate(FragmentA=list_item_8.Item1, FragmentB=";", FragmentC=list_item_8.Item)

# ---- group: INPUT
name_of_supported_surface = Panel("S1")
name_of_subsoil = Panel("Subsoil1")

# ----
surface_edge_support = SurfaceEdgeSupport(
    Edge=panel_9,
    NamePrefix="SSE",
    Tx=2,
    Ty=2,
    Tz=7,
    Rx=2,
    Ry=2,
    Rz=2,
    StiffnessTx=10,
    StiffnessTy=20,
    StiffnessTz=30,
    StiffnessRx=40,
    StiffnessRy=50,
    StiffnessRz=60,
    FunctionTz=non_linear_function_name,
    CoordSystem=1,
    CoordDefinition=1,
    Position1=start_position,
    Position2=end_position,
    Origin=0)

# ----
# Supports
list_item_9 = ListItem(List=list_item_4, Index=0, Wrap=True)  # -> Item, Item1, Item2, Item3
panel_10 = Panel(surface_edge_support)

beam_point_support = BeamPointSupport(
    Beams=[list_item_9.Item, list_item_9.Item2],
    NamePrefix="SB",
    Tx=0,
    Ty=0,
    Tz=0,
    Rx=1,
    Ry=1,
    Rz=1,
    StiffnessTx=0,
    StiffnessTy=0,
    StiffnessTz=0,
    StiffnessRx=0,
    StiffnessRy=0,
    StiffnessRz=0,
    CoordSystem=0,
    CoordDefinition=1,
    PositionX=[posx, posx_2],
    Origin=0,
    Repeat=repeat,
    DeltaX=0.1)

beam_line_support = BeamLineSupport(
    Beams=[list_item_9.Item1, list_item_9.Item3],
    NamePrefix="SBL",
    Tx=1,
    Ty=1,
    Tz=0,
    Rx=0,
    Ry=0,
    Rz=0,
    StiffnessTx=0,
    StiffnessTy=0,
    StiffnessTz=0,
    StiffnessRx=0,
    StiffnessRy=0,
    StiffnessRz=0,
    CoordSystem=1,
    CoordDefinition=0,
    Position1=abs_start_position,
    Position2=abs_end_position,
    Origin=0)

surface_support = SurfaceSupport(Surfaces=name_of_supported_surface, NamePrefix="SSS", Subsoil=name_of_subsoil)
subsoil = Subsoil(
    SubsoilName=name_of_subsoil,
    Description="Defined subsoil for surface support",
    C1x=50,
    C1y=50,
    C1z=50,
    C2x=0,
    C2y=0,
    C1ztype=1,
    NonlinearFunction=non_linear_function_name_2)

node_support = NodeSupport(
    Nodes=nodeatpoint,
    NamePrefix="Sn",
    Tx=1,
    Ty=1,
    Tz=1,
    Rx=1,
    Ry=1,
    Rz=1,
    StiffnessTx=0,
    StiffnessTy=0,
    StiffnessTz=0,
    StiffnessRx=0,
    StiffnessRy=0,
    StiffnessRz=0,
    CoordSystem="1",
    Angle="Rx20;Ry20;Rz20")

projectdata = ProjectData(
    ProjectName=project_name,
    Description=project_name,
    Author=author,
    Date=time,
    StructureType=8,
    Materials=project_materials,
    MeshSize=mesh_size,
    Scale=scale,
    RemDuplNodes=Toggle(True),
    Tolerance=0.001)

linehinge = LineHinge(
    _2DMemberEdgeList="S1;2",
    CoordDefinition=0,
    Position1=0.3,
    Position2=0.9,
    Origin=0,
    Tx=0,
    Ty=1,
    Tz=2,
    Rx=2,
    StiffnessTx=123456,
    StiffnessTy=234546,
    StiffnessTz=345678,
    StiffnessRx=456789)

position_2_both = Panel("2")
non_linear_function_name_3 = Panel("NLF1")

# ----
# Links
crosslink = CrossLink(Type=1, CoupledMembers=concatenate)

hinge = HingeOnBeam(
    Beams=concatenate,
    NamePrefix="H",
    Position=position_2_both,
    Tx=1,
    Ty=1,
    Tz=3,
    Rx=0,
    Ry=0,
    Rz=0,
    StiffnessTx=0,
    StiffnessTy=0,
    StiffnessTz=10,
    StiffnessRx=0,
    StiffnessRy=0,
    StiffnessRz=0,
    FunctionTz=non_linear_function_name_3)

# ----
# Tools
name_of_selection = Panel("MySelection")
selection_set = Panel("""B1
B2
S1
BN3
Sn2""")
selection = Selection(Name=name_of_selection, ObjectNames=selection_set, ObjectTypes=-1)

points_at_supports_2 = Point(top_corners)
nodeatpoint_2 = NodeAtPoint(nodedata=flatten(_1d_member.Nodes), points=points_at_supports_2)

loadgroup_names = Panel("""LG2
LG3""")
lg_relations = Panel("""Standard
Exclusive""")
loadcase_names = Panel("""LC2
LC3""")
lc_types = Panel("""Permanent
Variable""")
lc_load_groups = Panel("""LG1
LG2""")

linemomentonedge = LineMomentOnEdge(
    LoadCase="LC2",
    _2DMemberEdgeList="S1;1;edge",
    CoordSys=0,
    Direction=2,
    Distribution=0,
    LoadValue1=-100,
    LoadValue2=-100,
    CoordDefinition=0,
    Position1=0,
    Position2=1,
    Origin=0)

point = Point([Point(3.587175359, 0.5224049389, 0), Point(4.140812639, 0.4779668476, 0), Point(4.191153889, 1.183145484, 0), Point(3.686518926, 1.009454481, 0)])
polyline_6 = PolyLine(Vertices=point, Closed=True)
target_load_case = Panel("LC3")

F = Slider(-3.7, range=-10..0)
target_load_case_2 = Panel("LC2")
point_2 = Point(Point(3, 2, 0))

F_2 = Slider(-4.5, range=-10..0)
target_load_case_3 = Panel("LC3")

line_5 = Line(StartPoint=Point(0.7872880502, 0.5798496115, 0), EndPoint=Point(3.107454536, 0.5574897246, 0))
freelineload = FreeLineLoad(
    LoadCase="LC2",
    Validity=0,
    Selection=0,
    CoordSys=0,
    Direction=2,
    Distribution=0,
    LoadValue1=-1,
    LoadValue2=-1,
    Lines=line_5,
    ValidityFrom=0,
    ValidityTo=0)

F_3 = Slider(-3, range=-10..0)
target_load_case_4 = Panel("LC2")

# ----
# Loads
freepointmoment = FreePointMoment(
    LoadCase="LC2",
    Validity=5,
    Selection=0,
    CoordSys=0,
    Direction=0,
    LoadValue=-150,
    Points=Point(3.978138365, 2.025548552, 0),
    ValidityFrom=0,
    ValidityTo=0)

freesurfaceload = FreeSurfaceLoad(
    LoadCase=target_load_case,
    Validity=0,
    Selection=0,
    CoordSys=0,
    Direction=2,
    Distribution=3,
    LoadValue1=-1.5,
    LoadValue2=-2,
    LoadValue3=-2.5,
    Boundary=polyline_6,
    ValidityFrom=0,
    ValidityTo=0)

freepointload = FreePointLoad(
    LoadCase=target_load_case_2,
    Validity=0,
    Selection=0,
    CoordSys=0,
    Direction=2,
    LoadValue=F,
    Points=point_2,
    ValidityFrom=0,
    ValidityTo=0)

loadgroup = LoadGroup(Name=loadgroup_names, LoadType=1, Relation=lg_relations, VariableType=-1)
loadcase = LoadCase(Name=loadcase_names, Type=lc_types, LoadGroup=lc_load_groups)

pointloadonstructnode = PointLoadOnStructNode(LoadCase=target_load_case_3, NodeList=nodeatpoint_2, CoordSys=0, Direction=2, LoadValue=F_2, Angle="Rx0,Ry0,Rz0")

surfaceload = SurfaceLoad(LoadCase=target_load_case_4, SurfList=list_item_5, CoordSys=0, Direction=2, LoadValue=F_3)

# ---- group: Old definition
load_case_definitions = Panel("""LC2; Permanent; LG1
LC3; Variable; LG2""")
load_group_definitions = Panel("""LG2; Variable; Standard
LG3; Variable; Exclusive""")

loadcases = LoadCases(LoadCases=load_case_definitions, LoadGroups=load_group_definitions)  # -> LoadCases, LoadGroups

# ---- group: Ability to overwrite certain properties of existing project materials
panel_11 = Panel("Name:C20/25, MaterialType:Concrete, Density:2400 kg/m³, ShearModulus:1240 MPa, PoissonRatio:0.3, SpecificHeat:0.54 J/kg.K, CompressiveStrength:19 MPa, AggregateSize:20 mm, AggregateType:Limestone, CementClass:R")

# ---- group: The magic
filename = Panel("C:/TEMP/KoalaSoup.xml")
boolean_toggle = BooleanToggle(True)

# Create XML
createxml = CreateXML(
    Run=boolean_toggle,
    FileName=filename,
    ProjectData=flatten(projectdata),
    Layer=flatten(layers),
    Material=flatten(panel_11),
    CrossSection=flatten(crosssections),
    Selection=flatten(selection),
    Node=flatten(merge_3),
    _1DMember=flatten(_1d_member._1DMember),
    _2DMember=flatten(_2d_member._2DMember),
    LoadPanel=flatten(load_panel.LoadPanel),
    Opening=flatten(opening.Opening),
    ArbitraryProfile=flatten(arbitraryprofile),
    InternalEdge2D=flatten(internal_edge_on_2d_member.InternalEdge),
    NodeSupport=flatten(node_support),
    SurfaceEdgeSupport=flatten(surface_edge_support),
    BeamLineSupport=flatten(beam_line_support),
    BeamPointSupport=flatten(beam_point_support),
    SurfaceSupport=flatten(surface_support),
    Subsoil=flatten(subsoil),
    Hinge=flatten(hinge),
    LineHinge=flatten(linehinge),
    CrossLink=flatten(crosslink),
    LoadCase=flatten(loadcase),
    LoadGroup=flatten(loadgroup),
    PointLoadNode=flatten(pointloadonstructnode),
    FreePointLoad=flatten(freepointload),
    FreePointMoment=flatten(freepointmoment),
    LineMomentEdge=flatten(linemomentonedge),
    FreeLineLoad=flatten(freelineload),
    SurfaceLoad=flatten(surfaceload),
    FreeSurfaceLoad=flatten(freesurfaceload),
    NonLinearFunction=flatten(merge_4),
    SectionOn2D=flatten(section_on_2d))

# ==== cluster NodeAtPoint: Find the name of the Node at a coordinate
nodedata = ClusterInput()  # Combination of node names and coordinates, as returned by Koala Node, 1D Member, 2D Member... components
points = ClusterInput()  # Point coordinates at which to find the matching node names
nodedata_2 = Text(nodedata)
pts = Point(points)
partition_list = PartitionList(List=nodedata_2, Size=4)
split_list = SplitList(List=partition_list, Index=1)  # -> ListA, ListB
trim_tree = TrimTree(Tree=split_list.ListA, Depth=2)
number = Number(split_list.ListB)
list_item = ListItem(List=number, Index=0, Wrap=True)  # -> Item, Item1, Item2
pdecon = Deconstruct(Point=pts)  # -> XComponent, YComponent, ZComponent
expression = Expression(x=list_item.Item, y=list_item.Item1, z=list_item.Item2, Expression="{Round(x, 3),Round(y, 3),Round(z, 3)}")
expression_2 = Expression(x=pdecon.XComponent, y=pdecon.YComponent, z=pdecon.ZComponent, Expression="{Round(x, 3),Round(y, 3),Round(z, 3)}")
trim_tree_2 = TrimTree(Tree=expression, Depth=2)
mindex = MemberIndex(Set=trim_tree_2, Member=expression_2)  # -> Index, Count
trim_tree_3 = TrimTree(Tree=mindex.Index, Depth=1)
list_item_2 = ListItem(List=trim_tree, Index=trim_tree_3, Wrap=True)
nodenames = Text(list_item_2)
nodenames_2 = ClusterOutput(nodenames)  # Names of the nodes at the given coordinates
