# Grasshopper definition Koala_OldVsNewComponents.gh (Grasshopper 1.0.7)
# plug-ins: Koala

# ----
# INSTRUCTIONS
# ¯¯¯¯¯¯¯¯¯¯¯¯¯¯¯¯¯¯¯¯¯¯¯¯¯¯¯¯¯¯¯¯¯¯¯¯
# Sample created to demonstrate differences between old and new structure components. New components make better use of Grasshopper's data matching algorithms, while maintaining continuous numbering for member names.
line = Line(graft([Line((-17, -13, 0), (3, 8, 0)), Line((3, 8, 0), (23, -14, 0))]))
panel = Panel("""1
2""")
# INFO
# GENERAL INFO
# ¯¯¯¯¯¯¯¯¯¯¯¯¯¯¯¯¯¯¯¯¯¯¯¯¯¯¯¯¯¯¯¯¯¯¯¯
# Author: KRO
# Company: BESIX Engineering
# Email: kelvin.roovers@besix.com
# 
# Grasshopper version: 1.0.0007
# Rhino version: 7.11
# 
# 
# VERSION HISTORY
# ¯¯¯¯¯¯¯¯¯¯¯¯¯¯¯¯¯¯¯¯¯¯¯¯¯¯¯¯¯¯¯¯¯¯¯¯
# v0.01 (2022-12-13)
panel_2 = Panel("""1
2""")
unit_z = UnitZ(Factor=1)
beams = Beams(
    Curves=line,
    Sections="CS1",
    Layers="Beams",
    NodePrefix="NB",
    Tolerance=0.001,
    RemDuplNodes=True,
    StructuralType=0,
    FEMtype=0,
    MemberSystemLine=panel_2,
    Ey=0,
    Ez=0,
    BeamNamePrefix="B")  # -> Nodes, Beams
beam = Beam(
    Curve=line,
    ZVector=unit_z,
    Section="CS1",
    Layer="Beams",
    NodePrefix="NB",
    Tolerance=0.001,
    RemDuplNodes=False,
    StructuralType=0,
    FEMtype=0,
    MemberSystemLine=panel,
    Ey=0,
    Ez=0,
    BeamNamePrefix="T")  # -> Nodes, Beams
panel_3 = Panel(beams.Beams)
panel_4 = Panel(beam.Beams)
panel_5 = Panel(beam.Nodes)
panel_6 = Panel(beams.Nodes)

# ---- group: DEPRECATED NODES
beams_2 = Beams(
    Sections="CS1",
    Layers="Beams",
    NodePrefix="NB",
    Tolerance=0.001,
    RemDuplNodes=True,
    StructuralType=0,
    FEMtype=0,
    MemberSystemLine=1,
    Ey=0,
    Ez=0,
    BeamNamePrefix="B")  # -> Nodes, Beams
nodes = Nodes(NodePrefix="N")
openings = Openings(NodePrefix="NO", Tolerance=0.001, OpeningNamePrefix="O")  # -> Nodes, Openings
_2dmember = _2Dmember(
    Material="C20/25",
    SurfLayer="Surflayer",
    NodePrefix="N2D",
    Tolerance=0.001,
    RemDuplNodes=False,
    MemberSystemPlane=1,
    EccentricityZ=0,
    FEMNonlinearModel=0,
    SurfaceNamePrefix="S",
    SwapOrientation=0,
    LCSangle=0)  # -> Nodes, Surfaces
loadpanels = LoadPanels(
    LoadPanelNamePrefix="LP",
    LoadPanelsLayer="LoadPanelsLayer",
    PanelType=2,
    TransferDirection=2,
    TransferMethod=1,
    Tolerance=0.001,
    RemDuplNodes=False,
    SwapOrientation=0,
    LCSangle=0)  # -> Nodes, LoadPanels
slabinternaledge = SlabInternalEdge(InternalEdgeNamePrefix="ES", NodePrefix="NEN", Tolerance=0.001, RemDuplNodes=False)  # -> Nodes, InternalEdges
beaminternalnode = BeamInternalNode(NodePrefix="N")
createxml = CreateXML(
    StructureType=8,
    UILanguage=0,
    Materials="Concrete",
    MeshSize=0.15,
    FileName=" ",
    Scale="1",
    RemDuplNodes=False,
    OnDemand=False,
    Tolerance=0.001)

# ----
linehinge = LineHinge(
    CoordDefinition=0,
    Position1=0,
    Position2=1,
    Origin=0,
    Rx=1,
    Tx=1,
    Ty=1,
    Tz=1,
    StiffnessRx=0,
    StiffnessTx=0,
    StiffnessTy=0,
    StiffnessTz=0)
crosslink = CrossLink(Type=0)
noderigidarm = NodeRigidArm(RigidArmsPrefix="RA", HingeOnMaster=False, HingeOnSlave=False)
hinges = Hinges(
    Position=2,
    Rx=1,
    Ry=1,
    Rz=1,
    Tx=1,
    Ty=1,
    Tz=1,
    StiffnessRx=0,
    StiffnessRy=0,
    StiffnessRz=0,
    StiffnessTx=0,
    StiffnessTy=0,
    StiffnessTz=0)

beamsupport = BeamSupport(
    Rx=1,
    Ry=1,
    Rz=1,
    Tx=1,
    Ty=1,
    Tz=1,
    StiffnessRx=0,
    StiffnessRy=0,
    StiffnessRz=0,
    StiffnessRx_2=0,
    StiffnessTy=0,
    StiffnessTz=0,
    CoordDefinition=0,
    Position1=0,
    Position2=1,
    Origin=0)
edgesupport = EdgeSupport(
    Rx=1,
    Ry=1,
    Rz=1,
    Tx=1,
    Ty=1,
    Tz=1,
    StiffnessRx=0,
    StiffnessRy=0,
    StiffnessRz=0,
    StiffnessRx_2=0,
    StiffnessTy=0,
    StiffnessTz=0,
    CoordDefinition=0,
    Position1=0,
    Position2=1,
    Origin=0)
nodesupport = NodeSupport(
    Rx=1,
    Ry=1,
    Rz=1,
    Tx=1,
    Ty=1,
    Tz=1,
    StiffnessRx=0,
    StiffnessRy=0,
    StiffnessRz=0,
    StiffnessTx=0,
    StiffnessTy=0,
    StiffnessTz=0,
    Angle="Rx0,Ry0,Rz0")
pointsupportonbeam = PointSupportOnBeam(
    Rx=1,
    Ry=1,
    Rz=1,
    Tx=1,
    Ty=1,
    Tz=1,
    StiffnessRx=0,
    StiffnessRy=0,
    StiffnessRz=0,
    StiffnessRx_2=0,
    StiffnessTy=0,
    StiffnessTz=0,
    CoordDefinition=0,
    PositionX=0.5,
    Origin=0,
    Repeat=1,
    DeltaX=0.1)
surfacesupport = SurfaceSupport(Subsoil="Subsoil0")

boolean_toggle = BooleanToggle(True)
panel_7 = Panel("constant|125")
surface = Surface([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])
_2d_member = _2DMember(
    Surface=surface,
    Material="C20/25",
    Thickness="125",
    Layer="Surfaces",
    NodePrefix="N2D",
    Tolerance=0.001,
    RemDuplNodes=boolean_toggle,
    MemberSystemPlane=1,
    EccentricityZ=0,
    FEMNonlinearModel=0,
    MemberPrefix="S",
    SwapOrientation=False,
    LCSangle=0)  # -> Nodes, _2DMember
_2dmember_2 = _2Dmember(
    Surfaces=surface,
    Material="C20/25",
    Thickness="125",
    SurfLayer="Surflayer",
    NodePrefix="N2D",
    Tolerance=0.001,
    RemDuplNodes=boolean_toggle,
    MemberSystemPlane=1,
    EccentricityZ=0,
    FEMNonlinearModel=0,
    SurfaceNamePrefix="S",
    SwapOrientation=0,
    LCSangle=0)  # -> Nodes, Surfaces
panel_8 = Panel(_2dmember_2.Nodes)
panel_9 = Panel(_2d_member.Nodes)
panel_10 = Panel(_2dmember_2.Surfaces)
panel_11 = Panel(_2d_member._2DMember)

surface_2 = Surface([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])
panel_12 = Panel("N")
loadpanels_2 = LoadPanels(
    LoadPanelNamePrefix="LP",
    Surfaces=surface_2,
    LoadPanelsLayer="LoadPanelsLayer",
    PanelType=2,
    TransferDirection=2,
    TransferMethod=1,
    Tolerance=0.001,
    RemDuplNodes=False,
    SwapOrientation=0,
    LCSangle=0)  # -> Nodes, LoadPanels
load_panel = LoadPanel(
    Surface=surface_2,
    Layer="LoadPanels",
    PanelType=0,
    TransferDirection=1,
    TransferMethod=2,
    NodePrefix="LPN",
    Tolerance=0.001,
    RemDuplNodes=False,
    MemberPrefix="LP",
    SwapOrientation=False,
    LCSangle=0)  # -> Nodes, LoadPanel
panel_13 = Panel(loadpanels_2.Nodes)
panel_14 = Panel(load_panel.Nodes)
panel_15 = Panel(loadpanels_2.LoadPanels)
panel_16 = Panel(load_panel.LoadPanel)

polyline = PolyLine(Vertices=[Point(-5, -9, 0), Point(-10, -1, 0), Point(-3, 10, 0), Point(8, -2, 0), Point(10, -12, 0)], Closed=True)
circle = Circle(Plane=PlaneXY(0, 0, 0), Radius=1)
merge = Merge(Data1=polyline, Data2=circle)
openings_2 = Openings(ClosedCurves=merge, Surface="S1", NodePrefix="NO", Tolerance=0.001, OpeningNamePrefix="O")  # -> Nodes, Openings
opening = Opening(ClosedCurve=merge, Surface="S1", NodePrefix="NO", Tolerance=0.001, OpeningPrefix="O")  # -> Nodes, Opening
panel_17 = Panel(openings_2.Nodes)
panel_18 = Panel(opening.Nodes)
panel_19 = Panel(openings_2.Openings)
panel_20 = Panel(opening.Opening)

file_path = FilePath("C:\temp\SCIA\koala_loadpanel.xml")
createxml_2 = CreateXML(
    StructureType=8,
    UILanguage=0,
    Materials="Concrete",
    MeshSize=0.15,
    Nodes=flatten(load_panel.Nodes),
    FileName=file_path,
    Scale="1",
    RemDuplNodes=False,
    OnDemand=Toggle(True),
    Loadpanels=flatten(load_panel.LoadPanel),
    Tolerance=0.001)

panel_21 = Panel("""B1
B2""")
point = Point([Point(2, -17, 0), Point(-2, -8, 0), Point(14, 4, 0), Point(10, 9, 0)])
internal_node_on_1d_member = InternalNodeOn1DMember(Point=point, MemberName=panel_21, NodePrefix="N")
beaminternalnode_2 = BeamInternalNode(PointList=point, BeamNames=panel_21, NodePrefix="N")
panel_22 = Panel(beaminternalnode_2)
panel_23 = Panel(internal_node_on_1d_member)

boolean_toggle_2 = BooleanToggle(True)

panel_24 = Panel("""S1
S2""")
line_2 = Line([Line((11, -15, 0), (31, 1, 0)), Line((31, 1, 0), (21, 14, 0)), Line((14, 16, 0), (19, -2, 0))])
slabinternaledge_2 = SlabInternalEdge(
    SurfList=panel_24,
    Lines=line_2,
    InternalEdgeNamePrefix="ES",
    NodePrefix="NEN",
    Tolerance=0.001,
    RemDuplNodes=boolean_toggle_2)  # -> Nodes, InternalEdges
internal_edge_on_2d_member = InternalEdgeOn2DMember(Line=line_2, MemberName=panel_24, EdgePrefix="ES", NodePrefix="NEN", Tolerance=0.001, RemDuplNodes=boolean_toggle_2)  # -> Nodes, InternalEdge
panel_25 = Panel(internal_edge_on_2d_member.Nodes)
panel_26 = Panel(slabinternaledge_2.Nodes)
panel_27 = Panel(internal_edge_on_2d_member.InternalEdge)
panel_28 = Panel(slabinternaledge_2.InternalEdges)
